# Dynamo graph InsolationScale.dyn "mb.ge.template_new" (Dynamo 3.3.0.6316)
# author: MB Systems

python_script = Python()  # CPython3; unwired: IN[0]
# ---------- python_script.python (31 lines) ----------
import os
import sys
import importlib
from Dynamo.Applications import DynamoRevit
res = list()
workspace = DynamoRevit().RevitDynamoModel.CurrentWorkspace

full_path = workspace.FileName
file_name = os.path.splitext(os.path.basename(full_path))[0]
current_dir = os.path.dirname(full_path)
project_dir = os.path.join(
    current_dir,
    '%s.files' % file_name
)
sys.path.append(project_dir)

source = os.path.join(project_dir, 'main.py')

with open(source, 'r', encoding='utf-8') as file:
    code = file.read()

code = code.replace(
    "project_dir: str = None",
    "project_dir = r'%s'" % project_dir
) 
code = code.replace(
    'uiapp = revit.Application if revit else None',
    'uiapp = DocumentManager.Instance.CurrentUIApplication'
)

OUT = code
# ----------------------------------------
surface_construction_problems = PythonStringNode(script=python_script)  # CPython3; graph output; unwired: IN[0], IN[1], IN[2], IN[3], IN[4]
