# Dynamo graph mb.ge.template_new.dyn (Dynamo 3.3.0.6316)
# author: MB Systems

python_script = Python()  # CPython3; unwired: IN[0]
# ---------- python_script.python (48 lines) ----------
import os
import sys
import importlib
from Dynamo.Applications import DynamoRevit
res = list()
workspace = DynamoRevit().RevitDynamoModel.CurrentWorkspace

full_path = workspace.FileName
file_name = os.path.splitext(os.path.basename(full_path))[0]
current_dir = os.path.dirname(full_path)
project_dir = os.path.join(
    current_dir,
    '%s.files' % file_name
)
sys.path.append(project_dir)


modules_to_reload = ("lp_models",)
res = [
    name for name in os.listdir(project_dir)
    if os.path.isdir(os.path.join(project_dir, name))
]

for name in list(sys.modules):
    if any(name == m or name.startswith(m + ".") for m in modules_to_reload):
        del sys.modules[name] 

for module_name in modules_to_reload:
    break
    importlib.import_module(module_name) 

source = os.path.join(project_dir, 'main.py')

with open(source, 'r', encoding='utf-8') as file:
    code = file.read()

code = code.replace(
    "project_dir: str = None",
    "project_dir = r'%s'" % project_dir
) 
code = code.replace(
    'uiapp = revit.Application if revit else None',
    'uiapp = DocumentManager.Instance.CurrentUIApplication'
)



OUT = code
# ----------------------------------------
protection_level = CustomSelection("IV (R = 60 m)", items={I (R = 20 m): "20", II (R = 30 m): "30", III (R = 45 m): "45", IV (R = 60 m): "60"}, IsVisibleDropDownTextBlock=true)  # graph input
lightning_protection_family = StringInput("MB_BLZ_FS, MB_BLZ_FS-S, MB_BLZ_FSF")  # "Lightning protection Family names"; graph input
remove_previous_surfaces_on = BoolSelector(true)  # "Remove previous Surfaces (on current View)"; graph input
select_protection_points = BoolSelector(false)  # graph input
surface_construction_problems = PythonStringNode(script=python_script, IN[1]=protection_level, IN[2]=lightning_protection_family, IN[3]=remove_previous_surfaces_on, IN[4]=select_protection_points)  # CPython3; graph output; unwired: IN[0]
